# Grasshopper definition 00_UR_basicSettings.ghx (Grasshopper 1.0.7)
# plug-ins: Human

# ----
# Test Geometry
list = ValueList({"Without ribs": 0, "Ribs": 1}, selected="Without ribs")  # disabled
list_2 = ValueList({"No Infill": 0, "Spike": 1, "Chamfer": 2}, selected="Chamfer")  # disabled
crv = Curve(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)  # disabled
number_slider = Slider(100, range=0..500)  # disabled
number_slider_2 = Slider(200, range=20..2000)  # disabled
infill_offset = Slider(-13, range=-50..50)  # disabled
infill_zoffset = Slider(0, range=-10..100)  # disabled
end_gap = Slider(0, range=0..100)  # disabled
crv_2 = Curve(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)  # disabled
rib_span = Slider(217, range=20..2000)  # disabled
number_slider_3 = Slider(92.4, range=0..100)  # disabled
number_slider_4 = Slider(50, range=0..100)  # disabled
number_slider_5 = Slider(30.8, range=0..100)  # disabled
chamfer_wid = Slider(40, range=0..100)  # disabled
divide_interval = Slider(50, range=0..100)  # disabled
pathgenerator = GhPythonScript(
    crv=crv_2,
    shell_typ=list,
    rib_span=rib_span,
    rib_wid=number_slider_3,
    rib_dep=number_slider_4,
    infill_typ=list_2,
    infill_span=number_slider_2,
    infill_div=number_slider_5,
    infill_offset=infill_offset,
    chamfer_wid=chamfer_wid,
    end_gap=end_gap,
    divide_interval=divide_interval)  # -> seg1dir, inter_ls, segNormal, crv_segs, vis_pts, vis_attr; inputs crv: Curve, shell_typ: Int32, infill_typ: Int32, infill_span: Int32; disabled
# ---------- pathgenerator: Python ----------
__author__ = "Fen"
__spacing__= "-----ʕ•ᴥ•ʔ-----"
import Rhino.Geometry as rg
import ghpythonlib.components as ghc
import ghpythonlib.treehelpers as th
from  itertools import izip_longest, chain

def zip2Lists_flatten(list1, list2):
    """
    list1 = [1,1,1]
    list2 = [2,2,2,'A','A','A']
    result = [1, 2, 1, 2, 1, 2, 'A', 'A', 'A']
    """
    mapList = map(list, izip_longest(list1,list2, fillvalue=None))
    zipList = [i for sublist in mapList for i in sublist if i is not None]
    return zipList

def divide_crv(crv, divide_interval, endInc):
    crv_length = crv.GetLength()
    count = int(crv_length/divide_interval)
    params = crv.DivideByCount(count, endInc)
    points = [crv.PointAt(p) for p in params]
    tangents = [crv.TangentAt(p) for p in params]
    normals = [rg.Vector3d.CrossProduct(t, rg.Vector3d.ZAxis) for t in tangents]
    return points, normals

def swapPositions(list, pos1, pos2):
    list[pos1], list[pos2] = list[pos2], list[pos1]
    return list

def sortCrvs_xy(crvs):
    for i,crv in enumerate(crvs):
        crv.Domain =rg.Interval(0,1)

    mids=[crv.PointAt(0.5) for crv in crvs]
    ptsX = [pt.X for pt in mids]
    ptsY = [pt.Y for pt in mids]
    data = zip(ptsX, ptsY, crvs)
    data.sort()
    if data[1][1]>data[2][1]:
        swap = True
        #print "swap"
    else:
        swap = False
        #print "No swap"
    sorted_crvs = [crv for x,y,crv in data]
    if swap:
        sorted_crvs = swapPositions(sorted_crvs, 1, 2)
    sorted_crvs = swapPositions(sorted_crvs, 2, 3)
    return sorted_crvs

#def pt2_ribPts(param,normal, crv, rib_wid, rib_dep):
#    rib_pts = []
#    rib_pts.append(crv.PointAt(param-rib_wid/2))
#    rib_pts.append(crv.PointAt(param-rib_wid/2) + n*rib_dep)
#    rib_pts.append(crv.PointAt(param+rib_wid/2) + n*rib_dep)
#    rib_pts.append(crv.PointAt(param+rib_wid/2))
#    return rib_pts

def pt2_ribPts(param,normal, crv, rib_wid, rib_dep):
    rib_pts = []
    rib_pts.append(crv.PointAt(param-rib_wid/2))
    rib_pts.append(crv.PointAt(param) + n*rib_dep)
    rib_pts.append(crv.PointAt(param+rib_wid/2))
    return rib_pts


"""Sort edges order"""
bb = crv.GetBoundingBox(rg.Plane.WorldXY)
bb_edges = bb.GetEdges()
bb_segs = []
for i,seg in enumerate(bb_edges):
    if i<4:
        seg=rg.Line.ToNurbsCurve(seg)
        bb_segs.append(seg)
bb_segs= sortCrvs_xy(bb_segs)

"""Check crv direction"""
crv_segs = crv.DuplicateSegments()
crv_segs = sortCrvs_xy(crv_segs)
seg1= crv_segs[0]
start = seg1.PointAt(0.0)
end = seg1.PointAt(1.0)
seg1dir = end -start
segNormal = rg.Vector3d.CrossProduct(rg.Vector3d.XAxis,seg1dir)
reverseCrv = False
if segNormal.Z >0:
    reverseCrv = True
    print "need toreverse"
if reverseCrv:
    for crv in crv_segs:
        crv.Reverse()
        print "reversed"

crv_segs[3].Reverse()

top_crv = crv_segs[3]
top_crv.Domain = rg.Interval(0, top_crv.GetLength())
bot_crv = crv_segs[1]
bot_crv.Domain = rg.Interval(0, bot_crv.GetLength())

"""Check if input curve has curvature"""
straight = None
check = [seg.Degree for seg in crv_segs]
if sum(check) > len(crv_segs):
    straight = False
elif sum(check) == len(crv_segs):
    straight = True
"""----------------------------------"""

wayPt_nlist=[]
for i,seg in enumerate(crv_segs):
    pts=[]
    if straight:
        if i ==0:
            v = seg.PointAtEnd - seg.PointAtStart
            v.Unitize()
            pts.append(seg.PointAtStart+v*end_gap)
        elif i==1:
            pts.append(seg.PointAtStart)
        elif i==2:
            pts.append(seg.PointAtStart)
        elif i ==len(crv_segs)-1:
            seg.Reverse()
            pts.append(seg.PointAtStart)
            v = seg.PointAtStart-seg.PointAtEnd
            v.Unitize()
            pts.append(seg.PointAtEnd+v*end_gap)
    else:
        if seg.Degree==1:
            if i==0:
                v = seg.PointAtEnd - seg.PointAtStart
                v.Unitize()
                pts.append(seg.PointAtStart+v*end_gap)
                pts.append(seg.PointAtEnd)
            else:
                pts.append(seg.PointAtStart)
        else:
            if i==1:
                pts,_ = divide_crv(seg, divide_interval, False)
            else:
                pts,_ = divide_crv(seg, divide_interval, True)
                pts.pop(0)
    wayPt_nlist.append(pts)


"""Add ribs if necessary"""
if shell_typ ==1:
    rib_count = int(top_crv.GetLength()/rib_span)*2
    if rib_count%2!=0:
        rib_count +=1
        
    top_rib_params = top_crv.DivideByCount(rib_count, True)
    top_rib_params = top_rib_params[1:-1]
    top_rib_tangents = [top_crv.TangentAt(p) for i,p in enumerate(top_rib_params)]
    top_rib_normals = [rg.Vector3d.CrossProduct(t, rg.Vector3d.ZAxis) for t in top_rib_tangents]
    top_rib_pts =[]
    for i,(p,n) in enumerate(zip(top_rib_params,top_rib_normals)):
        top_rib_pts.extend(pt2_ribPts(p,n, top_crv, rib_wid, rib_dep))
    wayPt_nlist[3].extend(top_rib_pts)
    wayPt_nlist[3].append(wayPt_nlist[3].pop(1))
    
    bot_rib_params = bot_crv.DivideByCount(rib_count, True)
    bot_rib_params = bot_rib_params[1:-1]
    bot_rib_tangents = [bot_crv.TangentAt(p) for i,p in enumerate(bot_rib_params)]
    bot_rib_normals = [rg.Vector3d.CrossProduct(t, rg.Vector3d.ZAxis) for t in bot_rib_tangents]

    bot_rib_pts =[]
    for i,(p,n) in enumerate(zip(bot_rib_params,bot_rib_normals)):
        bot_rib_pts.extend(pt2_ribPts(p,n, bot_crv, rib_wid, rib_dep))
    wayPt_nlist[1].extend(bot_rib_pts)

WayPtAttribute_nlist = []
for pts in wayPt_nlist:
    l = []
    for pt in pts:
        l.append('shell')
    WayPtAttribute_nlist.append(l)

"""Drawing intersect lines from top edge"""
top_bb = bb_segs[3]
infill_count = int(top_bb.GetLength()/infill_span)*2
if infill_count%2!=0:
    infill_count +=1
infill_params = top_bb.DivideByCount(infill_count, True)
top_bb_pts = [top_bb.PointAt(p) for p in infill_params]
inter_ls = [rg.Line(rg.Point3d(pt.X, pt.Y+100000, pt.Z), rg.Vector3d.YAxis*-1000000) for pt in top_bb_pts]
inter_ls = [l.ToNurbsCurve() for l in inter_ls]


top_pts = []
bot_pts = []
for i,l in enumerate(inter_ls):
    if infill_typ ==0:
        if i%2==0:
            top_inter = rg.Intersect.Intersection.CurveCurve(top_crv, l, 0.01, 0.01)[0]
            pt = top_inter.PointA
            if i ==0:
                top_pts.append(pt)
            elif i==len(inter_ls)-1:
                top_pts.append(pt)
            else:
                p = top_inter.ParameterA
                v = rg.Vector3d.CrossProduct(top_crv.TangentAt(p), rg.Vector3d.ZAxis)
                v.Unitize()
                top_pts.append(pt+v*infill_offset*1)
    elif infill_typ == 1:
        if i%2==0:
            top_inter = rg.Intersect.Intersection.CurveCurve(top_crv, l, 0.01, 0.01)[0]
            pt = top_inter.PointA
            if i ==0:
                top_pts.append(pt)
            elif i==len(inter_ls)-1:
                top_pts.append(pt)
            else:
                p = top_inter.ParameterA
                v = rg.Vector3d.CrossProduct(top_crv.TangentAt(p), rg.Vector3d.ZAxis)
                v.Unitize()
                top_pts.append(pt+v*infill_offset*1)
        elif i%2==1:
            bot_inter = rg.Intersect.Intersection.CurveCurve(bot_crv, l, 0.01, 0.01)[0]
            pt = bot_inter.PointA
            p = bot_inter.ParameterA
            v = rg.Vector3d.CrossProduct(bot_crv.TangentAt(p), rg.Vector3d.ZAxis)
            v.Unitize()
            bot_pts.append(pt+v*infill_offset*1)

    elif infill_typ == 2:
        if i%2==0:
            top_inter = rg.Intersect.Intersection.CurveCurve(top_crv, l, 0.01, 0.01)[0]
            if i == 0:
                top_pts.append([top_inter.PointA])
            elif i ==len(inter_ls)-1:
                top_pts.append([top_inter.PointA])
            else:
                
                p0 = top_inter.ParameterA - chamfer_wid/2
                pt0 = top_crv.PointAt(p0)
                p1 = top_inter.ParameterA + chamfer_wid/2
                pt1 = top_crv.PointAt(p1)
                
                v0 = rg.Vector3d.CrossProduct(top_crv.TangentAt(p0), rg.Vector3d.ZAxis)
                v0.Unitize()
                v1 = rg.Vector3d.CrossProduct(top_crv.TangentAt(p1), rg.Vector3d.ZAxis)
                v1.Unitize()
                pts = [pt0+v0*infill_offset*1, pt1+v1*infill_offset*1]
                top_pts.append(pts)
        elif i%2==1:
            bot_inter = rg.Intersect.Intersection.CurveCurve(bot_crv, l, 0.01, 0.01)[0]
            p0 = bot_inter.ParameterA + chamfer_wid/2
            pt0 = bot_crv.PointAt(p0)
            p1 = bot_inter.ParameterA - chamfer_wid/2
            pt1 = bot_crv.PointAt(p1)
            
            v0 = rg.Vector3d.CrossProduct(bot_crv.TangentAt(p0), rg.Vector3d.ZAxis)
            v0.Unitize()
            v1 = rg.Vector3d.CrossProduct(bot_crv.TangentAt(p1), rg.Vector3d.ZAxis)
            v1.Unitize()
            pts = [pt0+v0*infill_offset*1, pt1+v1*infill_offset*1]
            bot_pts.append(pts)


if infill_typ ==0:
    pass
elif infill_typ == 1:
    infillPts = zip2Lists_flatten(top_pts,bot_pts)
elif infill_typ == 2:
    infillPts = zip2Lists_flatten(top_pts,bot_pts)
    infillPts = [i for sublist in infillPts for i in sublist]

infillPts_update = []
infillPts_attributes = []
if infill_typ == 0:
    pass
elif infill_typ == 1:
    for i,pt in enumerate(infillPts):
        if i!= len(infillPts)-1:
            v = infillPts[i+1] - pt
            d = v.Length
            v.Unitize()
            if i==0:
                infillPts_update.append(pt.Clone()+v*end_gap)
                infillPts_attributes.append('shell')
            else:
                infillPts_update.append(pt)
                infillPts_attributes.append('infill_corner')

#            infillPts_update.append(pt.Clone()+v*infill_div)
#            infillPts_attributes.append('infill_quar')
#            infillPts_update.append(pt.Clone()+v*d/2)
#            infillPts_attributes.append('infill_mid')
#            infillPts_update.append(pt.Clone()+v*(d-infill_div))
#            infillPts_attributes.append('infill_quar')
        else:
            infillPts_update.append(pt)
            infillPts_attributes.append('shell')
elif infill_typ == 2:
    for i,pt in enumerate(infillPts):
        if i!= len(infillPts)-1:
            v = infillPts[i+1] - pt
            d = v.Length
            v.Unitize()
            if i%2 ==0:
                if i==0:
                    infillPts_update.append(pt.Clone()+v*end_gap)
                    infillPts_attributes.append('shell')
                else:
                    infillPts_update.append(pt)
                    infillPts_attributes.append('infill_corner')
#                infillPts_update.append(pt.Clone()+v*infill_div)
#                infillPts_attributes.append('infill_quar')
#                infillPts_update.append(pt.Clone()+v*d/2)
#                infillPts_attributes.append('infill_mid')
#                infillPts_update.append(pt.Clone()+v*(d-infill_div))
#                infillPts_attributes.append('infill_quar')
            elif i%2 ==1:
                infillPts_update.append(pt)
                infillPts_attributes.append('infill_corner')
        else:
            infillPts_update.append(pt)
            infillPts_attributes.append('shell')

"""outline---infill---outline"""
if infill_typ != 0:
    infillPts_update.reverse()
    infillPts_attributes.reverse()
    
    wayPt_nlist.append(infillPts_update)
    WayPtAttribute_nlist.append(infillPts_attributes)
    

elif infill_typ == 0:
    pass

vis_pts = th.list_to_tree(wayPt_nlist)
vis_attr = th.list_to_tree(WayPtAttribute_nlist)
# ---------- end pathgenerator ----------
python = GhPythonScript(pts=flatten(pathgenerator.vis_pts))  # -> newPts; inputs pts: list of Point3d; disabled
# ---------- python: Python ----------
__author__ = "Fen"
import Rhino.Geometry as rg
"-------Import Personal Library-------"
from compas_rhino import unload_modules
unload_modules('e2e_pathSlicer')
import e2e_pathSlicer as ps
"-------------------------------------"

newPts = []

for i,pt in enumerate(pts):
    if  i != len(pts)-1:
        dis = pt.DistanceTo(pts[i+1])
        line = rg.Line(pt, pts[i+1])
        line = line.ToNurbsCurve()
        #print dis, type(line)
        if dis >= seg_length:
            extraPts,_ = ps.divide_crv(line, seg_length, False)
            #print "Order: ",i, len(extraPts)
            newPts.append(pt)
            newPts.extend(extraPts)
    else:
        newPts.append(pt)
# ---------- end python ----------
pline = PolyLine(Vertices=python, Closed=False)  # disabled
bbox = BoundingBox(Content=pline, Plane=PlaneXY(0, 0, 0))  # -> Box, Box_2; disabled
mirror = BooleanToggle(True)  # disabled
box = EvaluateBox(Box=bbox.Box, UParameter=0.5, VParameter=0.5, WParameter=0.5)  # -> Plane, Point, Include; disabled
order = PointOrder(Points=python)  # disabled
geo = Geometry(python)  # disabled
python_2 = GhPythonScript(object_height=number_slider, pts=python, mirrorPt=box.Point, mirror=mirror)  # -> out, targetPoint_nList; inputs pts: list of Point3d, mirrorPt: Point3d, mirror: Boolean; disabled
# ---------- python_2: Python ----------
__author__ = "Fen"
import Rhino.Geometry as rg
import ghpythonlib.components as ghc
import ghpythonlib.treehelpers as th
import math as m
from compas_ghpython import ghtree_to_list, list_to_ghtree 
from scriptcontext import sticky
"-------Import Personal Library-------"
from compas_rhino import unload_modules
unload_modules('data_structure')
import data_structure as ds
"-------------------------------------"

layer_count = m.ceil(object_height/layer_height)
layer_count = int(layer_count)
print layer_count

targetPoint_nList = []
for i in range(layer_count+1):
    T = rg.Transform.Translation(0,0,layer_height*i)
    moved_pts = [pt.Clone() for pt in pts]
    for pt in moved_pts:
        pt.Transform(T)
        if mirror:
            if i%2==1:
                M = rg.Transform.Mirror(mirrorPt, rg.Vector3d.XAxis)
                pt.Transform(M)
        else:
            pass
#    print len(moved_pts), type(moved_pts[2]), layer_height*i
    targetPoint_nList.append(moved_pts)
# ---------- end python_2 ----------

# ---- group: ori_pt
number_slider_6 = Slider(-287, range=-300..0)
# Calibration
# UR10 Calibration Points & Work Area
# 
# Tool tip should just touch the ruler!!!
# 
# You should feel it's hardly to move the ruler
panel = Panel("570")
ori_pt = ConstructPoint(XCoordinate=panel, YCoordinate="-260", ZCoordinate=number_slider_6)

# ---- group: xAxis_pt
xaxis_pt = ConstructPoint(XCoordinate="1170", YCoordinate="-260", ZCoordinate=number_slider_6)

# ---- group: yAxis_pt
yaxis_pt = ConstructPoint(XCoordinate="570", YCoordinate="260", ZCoordinate=number_slider_6)

# ---- group: diag_pt
diag_pt = ConstructPoint(XCoordinate="1170", YCoordinate="260", ZCoordinate=number_slider_6)

# ----
# Input Brep
brep = Brep(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)

# ----
# Print Adjustment
number_slider_7 = Slider(454.4, range=0..500)

# ----
# Slicing Parameters
layer_height = Slider(30, range=0.5..300)
offset_distance = Slider(7, range=0.5..50)
layer_count = Slider(1, range=1..10)
seg_length = Slider(25, range=5..200)

# ----
# Robot Parameters
velocity = Slider(140, range=0..999)
firstlayer_velocity = Slider(80, range=0..999)
travel_velocity = Slider(110, range=0..999)
acceleration = Slider(300, range=0..500)

# ----
# 1st Step Parameters
total_height = Slider(170, range=0..300)
total_width = Slider(120, range=0..300)
curb_height = Slider(115, range=0..300)
curb_width = Slider(70, range=0..300)
casting_depth = Slider(40, range=0..300)
pattern_start = Slider(11, range=0..100)
pattern_end = Slider(19, range=0..100)
skip_start = Slider(5, range=0..100)
skip_end = Slider(8, range=0..100)
block_width = Slider(300, range=0..500)
extend_width = Slider(100, range=0..500)

# ----
# End-effector installation position
robot_joint_angles = Panel("""-207.15
-19.71
44.50
-24.7
62.73
-0.32""")
robot_joint_angles_2 = Panel("""-213.5
-52.7
119.65
-66.43
56.21
-0.41""")
# Print Adjustment
list_3 = ValueList({"Right Front": 0, "Right Back": 1}, selected="Right Front")
filter = StreamFilter(Gate=list_3, Stream0=robot_joint_angles, Stream1=robot_joint_angles_2)
j = GhPythonScript(joints=filter)  # -> joints; inputs joints: list
# ---------- j: Python ----------
__author__ = "Fen"
import math as m

print "brfore: ", joints
joints = [m.radians(joints[i]) for i in range(len(joints))]
print "after: ", joints
# ---------- end j ----------

python_3 = GhPythonScript(rhino_oriPt=ori_pt, input_brep=brep, x_adjustment=number_slider_7, y_adjustment=Slider(0, range=0..500))  # -> out, rhino_boundary, moved_brep, T_rhino2UR, rhino_oriPt; inputs rhino_oriPt: Point3d, input_brep: Brep
# ---------- python_3: Python ----------
__author__ = "Fen"
import Rhino.Geometry as rg

input_bb = rg.Brep.GetBoundingBox(input_brep, rg.Plane.WorldXY)
T = rg.Point3d(rhino_oriPt.X+x_adjustment, rhino_oriPt.Y+y_adjustment, rhino_oriPt.Z) - input_bb.Min
moved_brep = input_brep.Duplicate()
moved_brep.Translate(T)
# ---------- end python_3 ----------

# ----
# Brep Slicing
toggle = BooleanToggle(False)
contour = GhPythonScript(
    brep=python_3.moved_brep,
    layer_height=layer_height,
    offset_distance=offset_distance,
    layer_count=layer_count,
    reverse=toggle)  # -> vis_contourCrvs, contourCrv_nList; inputs brep: Brep, layer_count: Int32, reverse: Boolean
# ---------- contour: Python ----------
__author__ = "Fen"
import Rhino.Geometry as rg
import ghpythonlib.components as ghc
import ghpythonlib.treehelpers as th
from compas_ghpython import ghtree_to_list, list_to_ghtree 
"-------Import Library-------"
from compas_rhino import unload_modules
unload_modules('e2e_pathSlicer')
import e2e_pathSlicer as ps
"-------------------------------------"

# get contour curves from a brep
contourCrvs = ps.contour_XY(brep, layer_height, True)

contourCrv_nList =[]

bbcs=[]

if layer_count==1:
    for i,crv in enumerate(contourCrvs):
        if reverse:
            if i%2==1:
                crv.Reverse()
    contourCrv_nList = [[crv] for crv in contourCrvs]
elif layer_count !=1:
    for crv in contourCrvs:
        crvs = []
        for j in range(layer_count):
            if j ==0:
                crvs.append(crv)
            else:
                bb = crv.GetBoundingBox(rg.Vector3d(0,0,1))
                #to check curve center
                bbcs.append(bb.Center)
                offset_crv = crv.Offset(bb.Center, rg.Vector3d(0,0,1), offset_distance*-j, 0.01, rg.CurveOffsetCornerStyle.Sharp)[0]
                print type(offset_crv)
                crvs.append(offset_crv)
        contourCrv_nList.append(crvs)

vis_contourCrvs = list_to_ghtree(contourCrv_nList)
# ---------- end contour ----------
dividecrvs = GhPythonScript(contourCrv_nList=contour.contourCrv_nList, seg_length=seg_length)  # -> simplify(vis_targetPoints), targetPoint_nList; inputs contourCrv_nList: list
# ---------- dividecrvs: Python ----------
__author__ = "Fen"
import Rhino.Geometry as rg
import ghpythonlib.components as ghc
import ghpythonlib.treehelpers as th
from compas_ghpython import ghtree_to_list, list_to_ghtree 
from scriptcontext import sticky
"-------Import Personal Library-------"
from compas_rhino import unload_modules
unload_modules('e2e_pathSlicer')
import e2e_pathSlicer as ps
"-------------------------------------"

"""
check if there's only a single path on each layer, 
if not, reverse every second layer
"""
check = [crv for list in contourCrv_nList for crv in list]
if len(contourCrv_nList) == len(check):
    # one curve on each layer
    pass
else:
    # multiple curves on each layer
    for i,layer in enumerate(contourCrv_nList):
        if i%2==1:
            layer.reverse()
            
"""
creat robot target points
"""
targetPoint_nList=[]
for crvs in contourCrv_nList:
    targetPoints = []
    for crv in crvs:
        print crv
        pts,_ = ps.divide_crv(crv, seg_length, True)
    targetPoint_nList.append(pts)





vis_targetPoints = list_to_ghtree(targetPoint_nList)
# ---------- end dividecrvs ----------

# ----
# First Step
pt = Point(<point referenced from the Rhino model>)
curb_block = GhPythonScript(
    start_pt=pt,
    seg_length=seg_length,
    total_height=total_height,
    total_width=total_width,
    curb_height=curb_height,
    curb_width=curb_width,
    casting_depth=casting_depth,
    pattern_start=pattern_start,
    pattern_end=pattern_end,
    skip_start=skip_start,
    skip_end=skip_end)  # -> pts, pattern_attributes, skip_attributes; inputs start_pt: Point3d, pattern_start: Int32, pattern_end: Int32, skip_start: Int32, skip_end: Int32
# ---------- curb_block: Python ----------
__author__ = "Fen"
import Rhino.Geometry as rg
"-------Import Personal Library-------"
from compas_rhino import unload_modules
unload_modules('e2e_pathSlicer')
import e2e_pathSlicer as ps
"-------------------------------------"
tolerance = float(25)
total_height = total_height + tolerance
total_width = total_width + tolerance
curb_height = curb_height
curb_width = curb_width#60 originally
casting_depth = casting_depth
extend_width = total_width - curb_width
extend_height = total_height - casting_depth - curb_height

pt_1 = start_pt + rg.Vector3d.XAxis*(extend_width)
pt_2 = pt_1 + rg.Vector3d.YAxis*(curb_height)
pt_3 = pt_2 + rg.Vector3d.XAxis*(curb_width)
pt_4 = pt_3 + rg.Vector3d.YAxis*(extend_height)
pt_5 = pt_2 + rg.Vector3d.YAxis*(extend_height)
pt_6 = pt_5 + rg.Vector3d.YAxis*(casting_depth)
pt_7 = pt_6 + rg.Vector3d.XAxis*(extend_width*-1)

corner_pts = [pt_1, pt_2, pt_3, pt_4, pt_5, pt_6, pt_7,start_pt ]
"""            0     1      2    3     4     5     6    7    """
noJoint_pts = [pt_1, pt_6, pt_7, start_pt]


pts = []
for i,pt in enumerate(corner_pts):
    if  i != len(corner_pts)-1:
        dis = pt.DistanceTo(corner_pts[i+1])
        line = rg.Line(pt, corner_pts[i+1])
        line = line.ToNurbsCurve()
        if dis >= seg_length:
            extraPts,_ = ps.divide_crv(line, seg_length, False)
            pts.append(pt)
            pts.extend(extraPts)
        else:
            pts.append(pt)
            if i!=2 or i!=3 or i!=4:
                pts_type.append(True)
            else:
                pts_type.append(False)
    else:
        dis = pt.DistanceTo(corner_pts[0])
        line = rg.Line(pt, corner_pts[0])
        line = line.ToNurbsCurve()
        if dis >= seg_length:
            extraPts,_ = ps.divide_crv(line, seg_length, False)
            pts.append(pt)
            pts.extend(extraPts)
            v = rg.Vector3d.XAxis*(seg_length/-2)
            pts.append(corner_pts[0]+v)
        else:
            pts.append(pt)

pattern_indexes = range(pattern_start, pattern_end+1)
pattern_attributes =[]
for i, pt in enumerate(pts):
    if i not in pattern_indexes:
        pattern_attributes.append(False)
    elif i in pattern_indexes:
        pattern_attributes.append(True)
        
skip_indexes =  range(skip_start, skip_end+1)
skip_attributes =[]
for i, pt in enumerate(pts):
    if i not in skip_indexes:
        skip_attributes.append(False)
    elif i in skip_indexes:
        skip_attributes.append(True)
# ---------- end curb_block ----------
pt_2 = Point(curb_block.pts)
pp_generator = GhPythonScript(
    layer_height=layer_height,
    block_width=block_width,
    extend_width=extend_width,
    base_pts=curb_block.pts,
    pattern_attributes=curb_block.pattern_attributes,
    skip_attributes=curb_block.skip_attributes)  # -> out, pt_nlist, attribute_nlist, vis; inputs base_pts: list of Point3d, pattern_attributes: list of Boolean, skip_attributes: list of Boolean
# ---------- pp_generator: Python ----------
__author__ = "Fen"
import Rhino.Geometry as rg
import math as m
from compas_ghpython import ghtree_to_list, list_to_ghtree 
"-------Import Personal Library-------"
from compas_rhino import unload_modules
unload_modules('e2e_data_structure')
import data_structure as ds
unload_modules('e2e_pathSlicer')
import e2e_pathSlicer as ps
"-------------------------------------"

layer_count = int(m.ceil(block_width/layer_height))
print layer_count ,layer_count * layer_height
#print int(m.trunc(layer_count))
layer_range = range(0, layer_count)
print layer_range, len(layer_range)

ext_count = int(m.ceil(extend_width/layer_height))
print ext_count ,ext_count * layer_height
#print int(m.trunc(layer_count))
ext_range = range(layer_range[-1]+1, layer_range[-1]+ext_count+1)
print ext_range, len(ext_range)

print layer_range+ext_range

pt_nlist =[]
attribute_nlist = []
for i in layer_range:
    pts = [rg.Point3d(pt.X, pt.Y, pt.Z + i*layer_height) for pt in base_pts]
    pt_nlist.append(pts)
    attribute_nlist.append(pattern_attributes)

for j in ext_range:
    ext_pts =[]
    patterns = []
    for pt, pattern, skip in zip(base_pts,pattern_attributes,skip_attributes):
        if not skip:
            ext_pts.append(rg.Point3d(pt.X, pt.Y, pt.Z + j*layer_height))
            patterns.append(pattern)
    pt_nlist.append(ext_pts)
    attribute_nlist.append(patterns)






vis = list_to_ghtree(pt_nlist)
# ---------- end pp_generator ----------
move = Move(Geometry=pt_2, Motion="{-10,10,0}")  # -> Geometry, Transform
points = PointList(Points=move.Geometry, Size=8)
pt_3 = Point(pp_generator.vis)

# ----
# Printing Area Visualization
boundary = PolyLine(Vertices=[ori_pt, xaxis_pt, diag_pt, yaxis_pt], Closed=True)
cluster = Cluster(G=ori_pt, G_3=xaxis_pt, print_boundary=boundary, G_2=yaxis_pt, ori=ori_pt)  # -> txt_2, D_2, swatch_2, D, swatch_4, panel, rhino_boundary, rhino_oript, R
previewlw = CustomPreviewLineweights(Geometry=cluster.rhino_boundary, Shader=cluster.swatch_4, Thickness=4, Absolute=False)
previewlw_2 = CustomPreviewLineweights(Geometry=boundary, Shader=cluster.swatch_2, Thickness=4, Absolute=False)
screentext = ScreenOrientedText(
    Text=cluster.txt_2,
    Font=cluster.panel,
    Justification=8,
    Location=cluster.R,
    SizeFactor=10,
    Color=[cluster.D_2, cluster.D],
    Depth=5,
    Absolute=False)

reset = Button()

# ----
# Add Pattern and Slice Data
list_4 = ValueList({"no filter", "wait", "movement", "velocity", "combined"}, selected="no filter")
wait_time = Slider(0.48, range=0..2)
lift_distance = Slider(10, range=0..15)

slice = BooleanToggle(True)
start_layer = Slider(2, range=0..30)
end_layer = Slider(14, range=0..50)

capped = BooleanToggle(False)
bottom_cap = Slider(2, range=0..10)
top_cap = Slider(4, range=0..10)

# ---- group: Select Target Pt
list_5 = ValueList({"Origin Point": 0, "X Axis Point": 1, "Y Axis Point": 2, "Diagonal Point": 3, "Safe Point": 4}, selected="X Axis Point")
filter_2 = StreamFilter(Gate=list_5, Stream0=ori_pt, Stream1=xaxis_pt, Stream2=yaxis_pt, Stream3=diag_pt)

# ----
# Robot TCP Adjustment
tcp_h = Slider(74.51, range=0..500)

# ----
# Set robot to installation position
# BEFOR or AFTER printing.
installation = Button()

# ----
# Move robot to a certain point
send = Button()

# ----
# Target Plane
pl = GhPythonScript(pt=filter_2)  # -> plane; inputs pt: Point3d
# ---------- pl: Python ----------
import Rhino.Geometry as rg

plane = rg.Plane(pt, rg.Vector3d.XAxis, rg.Vector3d.YAxis)
# ---------- end pl ----------
send_to = GhPythonScript(joints=j, target_plane=pl, tcp_height=tcp_h, installationPos=installation, send=send)  # -> script; inputs joints: list, target_plane: Plane, installationPos: Boolean
# ---------- send_to: Python ----------
from compas_rhino import unload_modules
unload_modules('simple_ur_script')
unload_modules('simple_comm')
import simple_comm as c
import simple_ur_script as ur
import Rhino.Geometry as rg
import math as m

# End-effector dimension
ed_x = 0
ed_y = 0
ed_z = 0

T = rg.Transform.Translation(0,0,tcp_height)
target_plane.Transform(T)
velocity = 0.10
acceleration = 0.05
blend_redious = 0.005

if installationPos:
    script = ""
    script += ur.set_tcp_by_angles(0, 0, 0, m.radians(-90.0), m.radians(0.0), m.radians(-90.0))#BIG!!!!
    script += ur.move_j(joints, acceleration, velocity)
    script = c.concatenate_script("def sendToSafePos():",script)
    c.send_script(script,"192.168.10.10")

elif send:
    script = ""
    script += ur.set_tcp_by_angles(0, 0, 0, m.radians(-90.0), m.radians(0.0), m.radians(-90.0))#BIG!!!!
    script += ur.move_l(target_plane, acceleration, velocity)
    script = c.concatenate_script("def sendToPt():",script)
    c.send_script(script,"192.168.10.10")
# ---------- end send_to ----------

# ---- group: checking data length
check_data_length = GhPythonScript()  # -> out
# ---------- check_data_length: Python ----------
__author__ = "Fen"
"-------Import Personal Library-------"
from compas_rhino import unload_modules
unload_modules('fab_data')
from scriptcontext import sticky as fab_data
"-------------------------------------"

if  len(fab_data['planes']) == len(fab_data['waits']) == len(fab_data['velocities']) == len(fab_data['accelerations']) == len(fab_data['blend_radiuses']):
    print ("data matches")
else:
    print ("data doesn't match")
    print 'planes:', len(fab_data['planes'])
    print 'waits:', len(fab_data['waits'])
    print 'velocities:', len(fab_data['velocities'])
    print 'accelerations:', len(fab_data['accelerations'])
    print 'blend_radiuses:', len(fab_data['blend_radiuses'])
# ---------- end check_data_length ----------
panel_2 = Panel(check_data_length)

# ----
# Export fab data as a json file
export = Button()

panel_3 = Panel("step_1_A")
panel_4 = Panel("firstStep_extension_30cm")

# ----
# Add a note to the name
panel_5 = Panel("mockUP2")

# ----
# Run test print
send_2 = Button()

# ----
# Send a plane to UR
test_print = GhPythonScript(send=send_2)  # -> script; inputs send: Boolean
# ---------- test_print: Python ----------
from compas_rhino import unload_modules
unload_modules('simple_ur_script')
unload_modules('simple_comm')
import simple_comm as c
import simple_ur_script as ur
import Rhino.Geometry as rg
import math as m

from scriptcontext import sticky as fab_data

#ed_x = 0
#ed_y = 80.00
#ed_z = 95.75
tcp_height =10
T = rg.Transform.Translation(0,0,tcp_height)
#target_plane.Transform(T)

if send:
    script = ""
    script += ur.set_tcp_by_angles(fab_data['ed_x'], fab_data['ed_y'], fab_data['ed_z'], m.radians(-90.0), m.radians(0.0), m.radians(-90.0))#BIG!!!!
    
    
    for i,(planes,vels,accels,blends,extrs) in enumerate(zip(fab_data['planes'],fab_data['velocities'],fab_data['accelerations'],fab_data['blend_radiuses'])):
        for j,(plane,vel,accel,blend,extr) in enumerate(zip(planes,vels,accels,blends,extrs)):
            if i==0 and j ==0:
                planeTo = plane.Clone()
                safeT = rg.Transform.Translation(0,-100,0)
                planeTo.Transform(safeT)
                script += ur.move_l(planeTo, 0.03, 0.2)
            else:
                script += ur.move_l_blend(plane, accel, vel, blend)
    
    script += ur.move_j(fab_data['safe_joints'], 0.03, 0.2)
    script = c.concatenate_script("def testPrint():",script)
    c.send_script(script,"192.168.10.10")
# ---------- end test_print ----------

panel_6 = Panel("""0
-1""")
send_3 = Button()

# ---- group: 500mm
list_6 = ValueList({"None", "Left", "Right", "Both"}, selected="Left")
layer_height_2 = Slider(8, range=0..1000)
support_height = Slider(50, range=0..1000)
print_pt_dist = Slider(25, range=0..1000)
base_crvs = Curve([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])
step_from_crvs = GhPythonScript(
    base_crvs=base_crvs,
    step_height="165",
    layer_height=layer_height_2,
    support_height=support_height,
    print_pt_dist=print_pt_dist,
    connecting=list_6)  # -> out, base_crvs, port, print_crvs_array, all_print_crvs, print_pts_array, all_print_pts, pattern_bools_array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; inputs base_crvs: list of Curve, step_height: Int32, layer_height: Int32, support_height: Int32
# ---------- step_from_crvs: Python ----------
"""
"""

__author__ = "jend"
__version__ = "2023.02.01"

import Rhino.Geometry as rg
import math as m
import copy as c
from ghpythonlib.components import BezierSpan

temp_geom = []

# crv tags
crv_tags = []
crv_tag_pts = []
for i,crv in enumerate(base_crvs):
    crv_tags.append(i)
    crv.Domain = rg.Interval(0,1)
    crv_tag_pts.append(crv.PointAt(0.5))

# layer heights and numbers
total_height = step_height + support_height
no_layers = int(m.floor(total_height/layer_height))
real_layer_height = total_height / no_layers

real_no_support_layers = step_height / real_layer_height
no_support_layers = int(m.floor(step_height / real_layer_height))


# connecting geometry
print connecting
curve_offset = 100
if connecting == "None":
    None
elif connecting == "Left":
    pt_1 = base_crvs[3].PointAtStart
    pt_2 = base_crvs[3].PointAtEnd
    
    temp_center = (pt_1 + pt_2) / 2
    temp_center_plane = rg.Plane(temp_center, rg.Vector3d.XAxis, rg.Vector3d.YAxis)
    
    temp_offset = curve_offset
    center_offset = temp_center - rg.Vector3d.YAxis * temp_offset / 2
    
    temp_curve = rg.Curve.CreateInterpolatedCurve([pt_1,center_offset,pt_2],3,rg.CurveKnotStyle.Uniform,-temp_center_plane.XAxis,-temp_center_plane.XAxis)
    base_crvs[3] = temp_curve
    
    # bezier style
    """
    temp_geom.append(temp_center)
    
    temp_offset = temp_center.DistanceTo(pt_1)
    center_offset = temp_center + rg.Vector3d.YAxis * temp_offset / 2
    temp_geom.append(center_offset)
    
    vector = pt_2 - pt_1
    test_bezier = BezierSpan(pt_1, -rg.Vector3d.XAxis * 50, center_offset, rg.Vector3d.XAxis * 50)
    temp_geom.append(test_bezier[0])
    """
    
elif connecting == "Right":
    pt_1 = base_crvs[5].PointAtStart
    pt_2 = base_crvs[5].PointAtEnd
    
    temp_center = (pt_1 + pt_2) / 2
    temp_center_plane = rg.Plane(temp_center, rg.Vector3d.XAxis, rg.Vector3d.YAxis)
    
    temp_offset = curve_offset
    center_offset = temp_center - rg.Vector3d.YAxis * temp_offset / 2
    
    temp_curve = rg.Curve.CreateInterpolatedCurve([pt_1,center_offset,pt_2],3,rg.CurveKnotStyle.Uniform,temp_center_plane.XAxis,temp_center_plane.XAxis)
    base_crvs[5] = temp_curve
    
elif connecting == "Both":
    pt_1 = base_crvs[3].PointAtStart
    pt_2 = base_crvs[3].PointAtEnd
    
    temp_center = (pt_1 + pt_2) / 2
    temp_center_plane = rg.Plane(temp_center, rg.Vector3d.XAxis, rg.Vector3d.YAxis)
    
    temp_offset = curve_offset
    center_offset = temp_center - rg.Vector3d.YAxis * temp_offset / 2
    
    temp_curve = rg.Curve.CreateInterpolatedCurve([pt_1,center_offset,pt_2],3,rg.CurveKnotStyle.Uniform,-temp_center_plane.XAxis,-temp_center_plane.XAxis)
    base_crvs[3] = temp_curve
    
    pt_1 = base_crvs[5].PointAtStart
    pt_2 = base_crvs[5].PointAtEnd
    
    temp_center = (pt_1 + pt_2) / 2
    temp_center_plane = rg.Plane(temp_center, rg.Vector3d.XAxis, rg.Vector3d.YAxis)
    
    temp_offset = curve_offset
    center_offset = temp_center - rg.Vector3d.YAxis * temp_offset / 2
    
    temp_curve = rg.Curve.CreateInterpolatedCurve([pt_1,center_offset,pt_2],3,rg.CurveKnotStyle.Uniform,temp_center_plane.XAxis,temp_center_plane.XAxis)
    base_crvs[5] = temp_curve


print_crvs_array = []
all_print_crvs = []

add_on_layers = 2
for i in range(no_layers):
    print_crvs = []
    temp_height = i * real_layer_height
    T = rg.Transform.Translation(0,0,temp_height)
    if i < no_support_layers:
        for j,crv in enumerate(base_crvs):
            temp_crv = c.copy(crv)
            temp_crv.Transform(T)
            print_crvs.append(temp_crv)
    elif i < no_support_layers + add_on_layers:
        temp_crvs = base_crvs[3:]
        for j,crv in enumerate(temp_crvs):
            temp_crv = c.copy(crv)
            temp_crv.Transform(T)
            print_crvs.append(temp_crv)
    else:
        temp_crv = c.copy(base_crvs[-2])
        temp_crv.Transform(T)
        print_crvs.append(temp_crv)
    print_crvs_array.append(print_crvs)
    all_print_crvs.extend(print_crvs)

print_pts_array = []
all_print_pts = []
pattern_bools_array = []
pattern_all_bools = []

for i,print_crvs in enumerate(print_crvs_array):
    temp_print_pts = []
    temp_bools = []
    for j,print_crv in enumerate(print_crvs):
        temp_params = print_crv.DivideByLength(print_pt_dist, True)
        if temp_params == None:
            count = 1
        else:
            count = len(temp_params)
        temp_params = print_crv.DivideByCount(count, True)
        temp_pts = [print_crv.PointAt(p) for p in temp_params]
        
        if i < no_support_layers:
            if j == 0:
                None
                bools = [False for pt in temp_pts]
            elif j > 0 and j < 3:
                temp_pts.pop(0)
                bools = [False for pt in temp_pts]
            elif j == 3:
                temp_pts.pop(0)
                temp_pts.pop()
                bools = [False for pt in temp_pts]
            elif j == 4:
                bools = [True for pt in temp_pts]
            elif j > 4:
                temp_pts.pop(0)
                bools = [False for pt in temp_pts]
        elif i < no_support_layers + add_on_layers:
            if j == 0:
                temp_pts.pop()
                bools = [False for pt in temp_pts]
            if j == 1:
                bools = [True for pt in temp_pts]
            if j == 2:
                temp_pts.pop(0)
                pt_1 = temp_pts[-1] + rg.Vector3d.ZAxis *10
                temp_pts.append(pt_1)
                bools = [False for pt in temp_pts]
        else:
            pt_1 = temp_pts[0] + rg.Vector3d.XAxis * print_pt_dist
            pt_2 = temp_pts[-1] + rg.Vector3d.XAxis * print_pt_dist
            pt_2_up = pt_2 + rg.Vector3d.ZAxis *10
            pt_3 = (pt_1 + pt_2) / 2 + rg.Vector3d.XAxis * curve_offset
            
            temp_pts.insert(0, pt_1)
            temp_pts.append(pt_2)
            temp_pts.append(pt_2_up)
            temp_pts.append(pt_3)
            
            bools = [True for pt in temp_pts]
            bools[0] = False
            bools[-2] = False
            bools[-1] = False
        temp_print_pts.extend(temp_pts)
        temp_bools.extend(bools)
    print_pts_array.append(temp_print_pts)
    all_print_pts.extend(temp_print_pts)
    pattern_bools_array.append(temp_bools)
    pattern_all_bools.extend(temp_bools)




"""


print_pts_array = []
all_print_pts = []
pattern_bools_array = []
pattern_all_bools = []

for i,print_crvs in enumerate(print_crvs_array):
    temp_print_pts = []
    temp_bools = []
    for j,print_crv in enumerate(print_crvs):
        temp_params = print_crv.DivideByLength(print_pt_dist, True)
        if temp_params == None:
            count = 1
        else:
            count = len(temp_params)
        temp_params = print_crv.DivideByCount(count, True)
        temp_pts = [print_crv.PointAt(p) for p in temp_params]
        if j != 0:
            temp_pts.pop(0)
        
        if i < no_support_layers:
            if j == 4:
                bools = [True for pt in temp_pts]
            elif j == 3:
                bools = [False for pt in temp_pts]
                bools[-1] = True
            else:
                bools = [False for pt in temp_pts]
        elif i < no_support_layers + 2:
            if j == 1:
                bools = [True for pt in temp_pts]
            elif j == 0:
                bools = [False for pt in temp_pts]
                bools[-1] = True
            else:
                bools = [False for pt in temp_pts]
        else:
            if j == 0:
                bools = [True for pt in temp_pts]
            else:
                bools = [False for pt in temp_pts]
        temp_print_pts.extend(temp_pts)
        temp_bools.extend(bools)
    print_pts_array.append(temp_print_pts)
    all_print_pts.extend(temp_print_pts)
    pattern_bools_array.append(temp_bools)
    pattern_all_bools.extend(temp_bools)
"""
# ---------- end step_from_crvs ----------
geo_2 = Geometry(step_from_crvs.base_crvs)
geo_3 = Geometry(step_from_crvs.all_print_pts)
geo_4 = Geometry(step_from_crvs.all_print_crvs)
panel_7 = Panel(step_from_crvs.no_layers)
panel_8 = Panel(step_from_crvs.no_support_layers)
tag = TextTag3D(
    Location=step_from_crvs.crv_tag_pts,
    Text=step_from_crvs.crv_tags,
    Size=Slider(35, range=0..100),
    Colour=ColourSwatch(SwatchColor=RGB(255, 0, 255)),
    Justification=7)
tag_2 = TextTag3D(
    Location=step_from_crvs.all_print_pts,
    Text=step_from_crvs.pattern_all_bools,
    Size=Slider(5, range=0..100),
    Colour=ColourSwatch(SwatchColor=RGB(255, 0, 255)),
    Justification=9)
idx = Slider(0, range=0..100)
print_pts_array = Data(step_from_crvs.print_pts_array)
pattern_bools_array = Data(step_from_crvs.pattern_bools_array)
layer_visu = GhPythonScript(print_crvs_array=step_from_crvs.print_crvs_array, idx=idx)  # -> out, layer_crvs; inputs print_crvs_array: list, idx: Int32
# ---------- layer_visu: Python ----------
"""
"""

__author__ = "jend"
__version__ = "2023.01.20"

layer_crvs = print_crvs_array[idx]
# ---------- end layer_visu ----------
panel_9 = Panel(step_from_crvs.print_crvs_array)
all_print_crvs = Geometry(step_from_crvs.all_print_crvs)
geo_5 = Geometry(layer_visu.layer_crvs)
eval = EvaluateCurve(Curve=all_print_crvs, Parameter=Slider(0.5, range=0..1))  # -> Point, Tangent, Angle
amp = Amplitude(Vector=eval.Tangent, Amplitude=Slider(50, range=0..100))
vdis = VectorDisplay(Anchor=eval.Point, Vector=amp)

# ---- group: 500mm / to fabrication
pattern_bools_array_2 = Data(step_from_crvs.pattern_bools_array)
print_pts_array_2 = Data(step_from_crvs.print_pts_array)

# ---- group: 500mm
layer_visu_2 = GhPythonScript(print_pts_array=print_pts_array, idx=idx)  # -> out, layer_pts; inputs print_pts_array: list, idx: Int32
# ---------- layer_visu_2: Python ----------
"""
"""

__author__ = "jend"
__version__ = "2023.01.20"

layer_pts = print_pts_array[idx]
# ---------- end layer_visu_2 ----------
panel_10 = Panel(step_from_crvs.print_pts_array)
all_print_pts = Geometry(step_from_crvs.all_print_pts)
geo_6 = Geometry(layer_visu_2.layer_pts)

# ----
# Data Filter
list_7 = ValueList({"Slicing Brep": 0, "First Step": 1, "David's": 2}, selected="First Step")
filter_3 = StreamFilter(Gate=list_7, Stream0=dividecrvs.targetPoint_nList, Stream1=pp_generator.pt_nlist, Stream2=print_pts_array_2)
filter_4 = StreamFilter(Gate=list_7, Stream0=dividecrvs.targetPoint_nList, Stream1=pp_generator.attribute_nlist, Stream2=pattern_bools_array_2)

# ----
# Fabrication Data
# Add Pattern
fabrication_data = GhPythonScript(
    printPoint_nList=filter_3,
    attribute_nList=filter_4,
    rhino_oriPt=cluster.rhino_oript,
    ori_pt=ori_pt,
    xAxis_pt=xaxis_pt,
    yAxis_pt=yaxis_pt,
    safe_joints=j,
    velocity=velocity,
    acceleration=acceleration,
    firstLayer_velocity=firstlayer_velocity,
    travel_velocity=travel_velocity,
    slice=slice,
    start_layer=start_layer,
    end_layer=end_layer,
    reset=reset)  # -> printPoint_nList, attribute_nList, vis; inputs printPoint_nList: list, attribute_nList: list, rhino_oriPt: Point3d, ori_pt: Point3d, xAxis_pt: Point3d, yAxis_pt: Point3d, safe_joints: list, slice: Boolean, start_layer: Int32, end_layer: Int32, reset: Boolean
# ---------- fabrication_data: Python ----------
__author__ = "Fen"
import Rhino.Geometry as rg
import ghpythonlib.components as ghc
import ghpythonlib.treehelpers as th
from compas_ghpython import ghtree_to_list, list_to_ghtree 
"-------Import Personal Library-------"
from compas_rhino import unload_modules
unload_modules('e2e_pathSlicer')
unload_modules('e2e_data_structure')
import e2e_pathSlicer as ps
import e2e_data_structure as ds
unload_modules('fab_data')
from scriptcontext import sticky as fab_data
"-------------------------------------"

def rhino_to_robot_space(rhino_plane, rhino_basePlane, robot_basePlane):
    """ this function translates planes from the rhino cordinate system to
        the robot cordinate system.
        It uses "inputBase_pt", which should use the bottom left corner point(from top view in Rhino)
        to construct a "rhino plane",
        and get a transform matrix from it to the "robot base plane"
    """
    robot_plane = rhino_plane.Clone()
    _matrix = rg.Transform.PlaneToPlane(rhino_basePlane, robot_basePlane)
    robot_plane.Transform(_matrix)
    return robot_plane

""" Change volicity unit from m to mm """
velocity = velocity/1000
acceleration = acceleration/1000
firstLayer_velocity = firstLayer_velocity/1000
travel_velocity = travel_velocity/1000

#""" Here we create a robot base plane """
#rhino_basePlane = rg.Plane(rhino_basePt, rg.Vector3d.ZAxis)
#robot_basePlane = rg.Plane(ori_pt, xAxis_pt - ori_pt, yAxis_pt - ori_pt)

""" Slice if needed """
if slice:
    printPoint_nList = printPoint_nList[start_layer:end_layer+1]
    attribute_nList =attribute_nList[start_layer:end_layer+1]
else:
    pass

""" Set / Reset data """
if reset:
    fab_data.clear()
else:
    fab_data['planes'] = []
    fab_data['waits'] = []
    fab_data['velocities'] = []
    fab_data['accelerations'] =[]
    fab_data['blend_radiuses'] =[]
    
    fab_data['ed_x'] = 0
    fab_data['ed_y'] = 0
    fab_data['ed_z'] = 0
    fab_data['safe_joints'] = safe_joints
    fab_data['robot_points'] = [ori_pt, xAxis_pt, yAxis_pt]
    fab_data['rhino_points'] = [rhino_oriPt]
    fab_data['firstLayer_velocity'] = [firstLayer_velocity]
    fab_data['travel_velocity'] = [travel_velocity]

""" Here we create other parameters for the robot """
for i,pts in enumerate(printPoint_nList):
    vels = []
    accels = []
    if i==0:
        for pt in pts:
            vels.append(fab_data['firstLayer_velocity'][0])
            accels.append(acceleration)
    else:
        for pt in pts:
            vels.append(velocity)
            accels.append(acceleration)
    fab_data['velocities'].append(vels)
    fab_data['accelerations'].append(accels)


vis = list_to_ghtree(printPoint_nList)
# ---------- end fabrication_data ----------
pattern_filter = GhPythonScript(
    printPoint_nList=fabrication_data.printPoint_nList,
    attribute_nList=fabrication_data.attribute_nList,
    type=list_4,
    capped=capped,
    bottom_cap=bottom_cap,
    top_cap=top_cap,
    wait_time=wait_time,
    lift_distance=lift_distance)  # -> vis, visPlane_nList; inputs printPoint_nList: list, attribute_nList: list, capped: Boolean, bottom_cap: Int32, top_cap: Int32
# ---------- pattern_filter: Python ----------
__author__ = "Fen"
import Rhino.Geometry as rg
import ghpythonlib.components as ghc
import ghpythonlib.treehelpers as th
from compas_ghpython import ghtree_to_list, list_to_ghtree 

"-------Import Personal Library-------"
from compas_rhino import unload_modules
unload_modules('data_structure')
import e2e_data_structure as ds
unload_modules('fab_data')
from scriptcontext import sticky as fab_data
unload_modules('e2e_pathSlicer')
import e2e_pathSlicer as ps
"-------------------------------------"

def rhino_to_robot_space(rhino_plane, rhino_basePlane, robot_basePlane):
    """ this function translates planes from the rhino cordinate system to
        the robot cordinate system.
        It uses "inputBase_pt", which should use the bottom left corner point(from top view in Rhino)
        to construct a "rhino plane",
        and get a transform matrix from it to the "robot base plane" """
    robot_plane = rhino_plane.Clone()
    _matrix = rg.Transform.PlaneToPlane(rhino_basePlane, robot_basePlane)
    robot_plane.Transform(_matrix)
    return robot_plane
    
def patternIndex_list(bottom_cap, top_cap, list_length):
    index_list = range(list_length)
    if bottom_cap==0 and top_cap !=0:
        return index_list[:top_cap*-1]
    elif bottom_cap!=0 and top_cap ==0:
        return index_list[bottom_cap:]
    elif bottom_cap==0 and top_cap ==0:
        return index_list
    else:
        return index_list[bottom_cap:top_cap*-1]


        
#if reset:
#    fab_data.clear()
#    fab_data['planes'] = None
#else:
#    fab_data['planes'] = targetPlane_nList
#    fab_data['waits'] = []
#    fab_data['velocities'] = []
#    fab_data['accelerations'] =[]
#    fab_data['blend_radiuses'] =[]

""" Here we create a robot base plane """
rhino_basePlane = rg.Plane(fab_data['rhino_points'][0], rg.Vector3d.ZAxis)
robot_basePlane = rg.Plane(fab_data['robot_points'][0], fab_data['robot_points'][1] - fab_data['robot_points'][0], fab_data['robot_points'][2] - fab_data['robot_points'][0])
#""" Create print planes from points """
#targetPlane_nList = []
#vis = []
#for pts in printPoint_nList:
#    rhino_planes = [rg.Plane(pt, rg.Vector3d.ZAxis) for pt in pts]
#    target_planes = [rhino_to_robot_space(rhino_plane, rhino_basePlane, robot_basePlane) for rhino_plane in rhino_planes]
#    targetPlane_nList.append(target_planes)
#    vis.extend(target_planes)

if type =="no filter":
    print "No pattern"
    fab_data['waits'] = ds.duplicateData_nlist(printPoint_nList, 0)
    for i,pts in enumerate(printPoint_nList):
        blends = ps.calc_blendRadius(pts, buffer=0.001*0.4)
        fab_data['blend_radiuses'].append(blends)
        rhino_planes = [rg.Plane(pt, rg.Vector3d.ZAxis) for pt in pts]
        print_planes = [rhino_to_robot_space(rhino_plane, rhino_basePlane, robot_basePlane) for rhino_plane in rhino_planes]
        fab_data['planes'].append(print_planes)
    visPlane_nList = fab_data['planes']
    vis=list_to_ghtree (visPlane_nList)

elif type =="wait":
    print "pattern from delaying"
    vis = []
    for i, pts in enumerate(printPoint_nList):
        blends = ps.calc_blendRadius(pts, buffer=0.001*0.4)
        fab_data['blend_radiuses'].append(blends)
        rhino_planes = [rg.Plane(pt, rg.Vector3d.ZAxis) for pt in pts]
        target_planes = [rhino_to_robot_space(rhino_plane, rhino_basePlane, robot_basePlane) for rhino_plane in rhino_planes]
        fab_data['planes'].append(target_planes)
        
        waits = []
        for j,pt in enumerate(pts):
            if i==0:
                waits.append(0)
            else:
                if i%2==1:
                    if j%2==0:
                        waits.append(wait_time)
                    else:
                        waits.append(0)
                elif i%2==0:
                    if j%2==0:
                        waits.append(0)
                    else:
                        waits.append(wait_time)
        fab_data['waits'] = [].append(waits)
        
    visPlane_nList = fab_data['planes']
    vis=list_to_ghtree (visPlane_nList)
    
elif type == "movement":
    print "pattern from movement"
    if capped:
        pattern_layer = patternIndex_list(bottom_cap,top_cap, len(printPoint_nList))
        print "capped, layer with pattern", pattern_layer
    else:
        pattern_layer = patternIndex_list(1,0, len(printPoint_nList))
        print "not capped, layer with pattern", pattern_layer
        
    new_printPoint_nList = []
    for i, (pts, attributes) in enumerate(zip(printPoint_nList,attribute_nList)):
        new_pts = []
        for j,(pt,attri) in enumerate(zip(pts,attributes)):
            if i not in pattern_layer:
                new_pts.append(pt)
            else :
                if attri:
                    if i%2==1:
                        if j%2==0:
                            new_pts.append(pt+rg.Vector3d(0,0,-lift_distance))
                        else:
                            new_pts.append(pt+rg.Vector3d(0,0,lift_distance))
                    elif i%2==0:
                        if j%2==0:
                            new_pts.append(pt+rg.Vector3d(0,0,lift_distance))
                        else:
                            new_pts.append(pt+rg.Vector3d(0,0,-lift_distance))
                else:
                    new_pts.append(pt)

        new_printPoint_nList.append(new_pts)
    
    fab_data['waits'] = ds.duplicateData_nlist(printPoint_nList, 0)
    vis = []
    for i,pts in enumerate(new_printPoint_nList):
        blends = ps.calc_blendRadius(pts, buffer=0.001*0.4)
        fab_data['blend_radiuses'].append(blends)
        rhino_planes = [rg.Plane(pt, rg.Vector3d.ZAxis) for pt in pts]
        target_planes = [rhino_to_robot_space(rhino_plane, rhino_basePlane, robot_basePlane) for rhino_plane in rhino_planes]
        fab_data['planes'].append(target_planes)
        
    visPlane_nList = fab_data['planes']
    vis=list_to_ghtree (visPlane_nList)

elif type == "velocity":
    print "pattern from velocity"
    pass
else:
    pass
# ---------- end pattern_filter ----------

# ---- group: total layer count
lng = ListLength(List=filter_3)
panel_11 = Panel(lng)

# ---- group: sliced layer count
lng_2 = ListLength(List=fabrication_data.printPoint_nList)
panel_12 = Panel(lng_2)

# ----
pt_4 = Point(pattern_filter.vis)
pt_5 = Point(fabrication_data.vis)
pline_2 = PolyLine(Vertices=pt_4, Closed=False)
points_2 = PointList(Points=pt_5, Size="10")

# ----
# Data visualization
slicedata = GhPythonScript(visPlane_nList=pattern_filter.visPlane_nList, slice=slice, start_layer=start_layer, end_layer=end_layer)  # -> out, simulation_planes; inputs visPlane_nList: list, slice: Boolean, start_layer: Int32, end_layer: Int32
# ---------- slicedata: Python ----------
__author__ = "Fen"



if slice and len(visPlane_nList)<end_layer:
    if start_layer ==0:
        raise IndexError("last layer is set out of the range")  


if slice:
    print len(visPlane_nList)
    simulation_planes = [plane for planes in visPlane_nList for plane in planes]
    print ("%s layers of planes will be simulated "%(len(visPlane_nList)))
    print ("planes from %s to %s layer will be simulated"%(start_layer, end_layer))
else:
    simulation_planes = [plane for planes in visPlane_nList for plane in planes]
    print ("%s layers of all planes will be simulated")%(len(visPlane_nList))
# ---------- end slicedata ----------
pt_6 = Point(slicedata.simulation_planes)
move_2 = Move(Geometry=pt_6, Motion="{0,0,4}")  # -> Geometry, Transform
pline_3 = PolyLine(Vertices=pt_6, Closed=False)
panel_13 = Panel(slicedata.out)
points_3 = PointList(Points=move_2.Geometry, Size=Slider(3, range=0..10))
item = ListItem(List=pt_6, Index=panel_6, Wrap=True)

restart = Button()
connect = Button()
disconnect = Button()
list_8 = ValueList({"simulation": 0, "real_robot": 1}, selected="simulation")
robot_name = ValueList({"ur10_2m"}, selected="ur10_2m")
dam = DataDam(DataA=slicedata.simulation_planes, BufferDelay=10000000, BufferMode=0)
ros = PythonScript(restart=restart, ip=list_8)  # -> ros_client
# ---------- ros: Python ----------
import time
import logging
import scriptcontext as sc

from compas_fab.backends import RosClient
from System import TimeSpan
from System.Threading import ManualResetEventSlim


LOGGER = logging.getLogger('roslibpy')

guid = str(ghenv.Component.InstanceGuid)
ros_client_key = "rosclient_" + guid

previous_client = sc.sticky.get(ros_client_key, None)
if previous_client:
    previous_client.terminate()

if ip == 0: #local
    ros_client = RosClient('127.0.0.1', 9090) #local, own laptop
elif ip == 1: #real robot
    ros_client = RosClient('127.0.0.1', 9090) #place holder

waitLock = ManualResetEventSlim(False)
ros_client.on_ready(lambda: waitLock.Set())

if not waitLock.Wait(TimeSpan.FromSeconds(5)):
    raise Exception('Unable to connect to ROS')

LOGGER.info('Connected to ROS')
# ---------- end ros ----------
connect_2 = PythonScript(ros_client=ros, connect=connect, disconnect=disconnect)  # -> out, ros_client
# ---------- connect_2: Python ----------
import logging
from System import TimeSpan
from System.Threading import ManualResetEventSlim

LOGGER = logging.getLogger('roslibpy')

if connect:
    if not ros_client.is_connected:
        LOGGER.debug('Connecting...')
        waitLock = ManualResetEventSlim(False)
        ros_client.on_ready(lambda: waitLock.Set())
        ros_client.connect()

        if not waitLock.Wait(TimeSpan.FromSeconds(5)):
            raise Exception('Unable to connect to ROS')
        LOGGER.debug('Reconnected')

if disconnect:
    if ros_client.is_connected:
        ros_client.terminate()
        LOGGER.debug('Terminated')
# ---------- end connect_2 ----------

# ----
# Load Robot from urdf
py = GhPythonScript()  # -> urdf_source
# ---------- py: Python ----------
import os
import sys

filepath = ghenv.Component.Attributes.Owner.OnPingDocument().FilePath
path = os.path.abspath(os.path.join(filepath, "..", ".."))
print(path)

urdf_source = os.path.abspath(os.path.join(path,"01_docs", "robot_description"))
# ---------- end py ----------
panel_14 = Panel(py)
path = PythonScript(path=panel_14, robot_name=robot_name)  # -> urdf_source
# ---------- path: Python ----------
import os

urdf_source = os.path.join(os.path.abspath(path), robot_name)

assert(os.path.isdir(urdf_source))
# ---------- end path ----------

# ---- group: 500mm
layer_visu_3 = GhPythonScript(pattern_bools_array=pattern_bools_array, idx=idx)  # -> out, layer_bools; inputs pattern_bools_array: list, idx: Int32
# ---------- layer_visu_3: Python ----------
"""
"""

__author__ = "jend"
__version__ = "2023.01.20"

layer_bools = pattern_bools_array[idx]
# ---------- end layer_visu_3 ----------
pattern_all_bools = Data(step_from_crvs.pattern_all_bools)

data = Data(layer_visu_3.layer_bools)
points_4 = PointList(Points=geo_6, Size=Slider(7, range=0..100))

panel_16 = Panel(data)

# ----
# Export Json
# Json to UR
export_json = GhPythonScript(note="step_2_A", export=export)  # -> attri, json_name, file_path
# ---------- export_json: Python ----------
import Rhino.Geometry as rg
import json
import os
from datetime import datetime
from scriptcontext import sticky as fab_data


""" TCP configuration needs to be implemented """
ed_x = 0
ed_y = 80.00
ed_z = 95.75
tcp_height =10
T = rg.Transform.Translation(0,0,tcp_height)


""" generating fabrication data """
data = {}
count = 0
for i,(planes,vels,accels,blends,waits) in enumerate(zip(fab_data['planes'],fab_data['velocities'],fab_data['accelerations'],fab_data['blend_radiuses'],fab_data['waits'])):
    for j,(plane,vel,accel,blend,wait) in enumerate(zip(planes,vels,accels,blends,waits)):
        point = {
        'frame' : {
            'point' : [plane.OriginX, plane.OriginY, plane.OriginZ],
            'xAxis' : [1.0, 0.0, 0.0],
            'yAxis' : [0.0, 1.0, 0.0]
            },
        'velocity' : vel,
        'acceleration' : accel,
        'blend_radus' : blend,
        'waits': wait,
        'layer' : i,
        'item' :j,
        
        'type' : 'print point'
        }
        data[count] = point
        count+=1

""" get location of GH fle"""
ghComp = ghenv.Component
ghDoc = ghComp.OnPingDocument()

""" the full path of the folder to save gh file """
current_path = ghDoc.FilePath
""" the target directory to dump json """
folder_path = os.path.abspath(os.path.join(current_path,"..","..","00_data","json"))

""" add time to the name """
now = datetime.today()
#currentDate = now.strftime("%y%m%d_")
currentDate = now.strftime("%y%m%d")
currentTime = now.strftime("%H%M")
print "time hhmm: ",currentTime

""" add a note to the name """
addNote = bool(note and not note.isspace())
if addNote:
    #attri =  "%s_"%(note) + currentDate + currentTime
    attri =  "%s_"%(note) + currentDate
else:
    #attri = currentDate + currentTime
    attri = currentDate

""" combining directory with file name """
json_name = 'e2e_printpoints_%s.json'%(attri)
print "json name: ", json_name
file_path = os.path.join(folder_path, json_name)
print "file path and name: ",file_path

""" exort json"""
if export:
    with open(file_path, 'w') as f:
            f.write(json.dumps(data, indent=3, sort_keys=True))
# ---------- end export_json ----------
panel_17 = Panel(export_json.attri)
panel_18 = Panel(export_json.file_path)
panel_19 = Panel(export_json.json_name)
recompute = Button()
py_2 = PythonScript()  # -> folder_path
# ---------- py_2: Python ----------
import sys
import os

ghComp = ghenv.Component
ghDoc = ghComp.OnPingDocument()

# the full path of the gh file
current_path = ghDoc.FilePath
# the current directory 
folder_path = os.path.abspath(os.path.join(current_path,"..","..","00_data","json"))

print folder_path
# ---------- end py_2 ----------
panel_20 = Panel(py_2)

dam_2 = DataDam(DataUpdate=panel_19, BufferDelay=10000000, BufferMode=0)
panel_21 = Panel(dam_2)

python_4 = GhPythonScript(recompute=recompute, json_name=panel_21, folder_path=py_2, send=send_3)  # -> out, script; inputs send: Boolean
# ---------- python_4: Python ----------
import os
import json
import Rhino.Geometry as rg
import math as m
import simple_comm as c
import simple_ur_script as ur
from compas.geometry import Frame

from scriptcontext import sticky as fab_data

def compasFrame_toRhinoPlane(data):
    x=data['frame']['point'][0]
    y=data['frame']['point'][1]
    z=data['frame']['point'][2]
    return rg.Plane(rg.Point3d(x,y,z), rg.Vector3d.ZAxis)


filename = os.path.join(folder_path,json_name)
print filename

with open(filename, 'r') as f:
    fabrication_data = json.load(f)

#ed_x = 0
#ed_y = 80.00
#ed_z = 95.75
#tcp_height =10
#T = rg.Transform.Translation(0,0,tcp_height)

print fab_data['firstLayer_velocity'][0]
vis=[]


if send:
    script = ""
    script += ur.set_tcp_by_angles(0, 0, 0, m.radians(-90.0), m.radians(0.0), m.radians(-90.0))
    
    for i in range(len(fabrication_data)):
        pl_data = fabrication_data[str(i)]


        if pl_data['layer'] ==0:
            """ first layer will be printed slower """
            if  pl_data['item'] ==0:
                """ construct a rhino target plane """
                plane = compasFrame_toRhinoPlane(pl_data)
                
                vis.append(plane)
                
                """
#                construct a start plane
                start_plane = plane.Clone()
                safeT = rg.Transform.Translation(0,-100,0)#this has to be visualized
                start_plane.Transform(safeT)
#                 move to safe plane
                script += ur.move_l_blend(start_plane, pl_data['acceleration'],  fab_data['travel_velocity'][0],pl_data['blend_radus'])
                """
                
                """ move to the first plane """
                script += ur.move_l_blend(plane, pl_data['acceleration'],  pl_data['velocity'],pl_data['blend_radus'])
            else:
                plane = compasFrame_toRhinoPlane(pl_data)
                """ move to the rest of planes on 1st layer """
                script += ur.move_l_blend(plane, pl_data['acceleration'],  fab_data['firstLayer_velocity'][0],pl_data['blend_radus'])
        else:
            """ the other layers """
            """ construct a rhino target plane """
            plane = compasFrame_toRhinoPlane(pl_data)
            

            """ move to target plane """
            script += ur.move_l_blend(plane, pl_data['acceleration'],  pl_data['velocity'],pl_data['blend_radus'])
            
            if  pl_data['waits'] !=0:
                script += ur.sleep(pl_data['waits'])
            
            if i != len(fabrication_data)-1:
                current_item = pl_data['item']
                next_item = fabrication_data[str(i+1)]['item']
                if next_item < current_item:
                    script += ur.textmsg(int(pl_data['layer']), ' layer is finished')
                    
            elif i == len(fabrication_data)-1:
                    script += ur.textmsg(int(pl_data['layer']), ' layer is finished, print is DONE')
                    script += ur.textmsg('move to safe position! ', 'happy printing!')
                    """ move to safe config """
                    script += ur.move_j(fab_data['safe_joints'], 0.03, 0.2)
    
    script = c.concatenate_script("def testPrint():",script)
    c.send_script(script,"192.168.10.10")
# ---------- end python_4 ----------
panel_22 = Panel(python_4.out)

# ----
# ROS Connection
# Robot Simulation
# Plan Cartesian Motion
load = BooleanToggle(True)
units = ValueList({"m": 1, "mm": 1000}, selected="mm")
robot = PythonScript(urdf_source=path, ros_client=connect_2.ros_client, scale_factor=units, load=load)  # -> out, robot
# ---------- robot: Python ----------
import os
from scriptcontext import sticky as st
import compas


from compas.robots import RobotModel
from compas.robots import LocalPackageMeshLoader
from compas_fab.ghpython import RobotArtist
from compas_fab.robots import RobotSemantics as RobotSemantics

from compas_fab.robots import Robot as Robot
from compas_fab.backends import RosClient

# Set high precision to import meshes defined in meters
compas.PRECISION = '12f'

# store data in component
guid = str(ghenv.Component.InstanceGuid)
robot_key = "robot_" + guid


if robot_key not in st:
    st[robot_key] = None


if ros_client and ros_client.is_connected and load == True:
    
    model = RobotModel.from_urdf_file(os.path.join(urdf_source, 'robot_description.urdf'))
    model.load_geometry(LocalPackageMeshLoader(urdf_source, 'robot_description'))
    semantics = RobotSemantics.from_srdf_file(os.path.join(urdf_source, 'robot_description.srdf'), model)
    artist = RobotArtist(model)
    robot = Robot(model, artist, semantics)
    
    robot.scale(scale_factor)
    st[robot_key] = robot

robot = st[robot_key]

if robot:
    robot.client = ros_client
# ---------- end robot ----------
info = PythonScript(robot=robot.robot)  # -> out, main_group_name
# ---------- info: Python ----------
if robot:
    robot.info()
    main_group_name = robot.main_group_name
# ---------- end info ----------
main_planning_group = Text(info.main_group_name)
panel_23 = Panel(info.out)
Y = UnitY(Factor=1)
Z = UnitZ(Factor=1)
pl_2 = ConstructPlane(Origin=dam, XAxis=Y, YAxis=Z)
py_3 = PythonScript(robot=robot.robot)  # -> configuration
# ---------- py_3: Python ----------
from compas_fab.robots import Configuration

if robot:
    types = robot.get_configurable_joint_types()
    values = [0] * len(types)

    configuration = Configuration(values, types)
    print configuration
# ---------- end py_3 ----------
pln = Plane(pl_2)
list_9 = ValueList({"0", "1"}, selected="0")
reverse = BooleanToggle(False)
compute = BooleanToggle(True)
iteration = Slider(1, range=0..10)
number_slider_8 = Slider(437, range=0..900)
panel_24 = Panel("positions")
panel_25 = Panel("velocities")
start = Button()
reset_2 = Button()
step = Button()
panel_26 = Panel("accelerations")
state = ValueList({"forward_kinematics": 0, "plan_cartesian_motion": 1}, selected="plan_cartesian_motion")
show_end_effector_frame = BooleanToggle(True)
show_visual = BooleanToggle(True)
show_axes = BooleanToggle(False)

# ----
# Configuration
j1 = Slider(-229, range=-360..360)
j2 = Slider(-45, range=-360..360)
j3 = Slider(129, range=-360..360)
j4 = Slider(-83, range=-360..360)
j5 = Slider(40, range=-360..360)
j6 = Slider(0, range=-360..360)
show = ValueList({"scan_pose": 0, "safe_pose": 1, "slider": 2}, selected="slider")
forward_kinematics = PythonScript(robot=robot.robot, group=main_planning_group, show=show, j1=j1, j2=j2, j3=j3, j4=j4, j5=j5, j6=j6)  # -> configuration
# ---------- forward_kinematics: Python ----------
import math
from compas_fab.robots import Configuration

if robot:
    if show == 0:
        joint_positions = [-10 + math.degrees(3.14159), -105, 165, 120, -80, 0]
    if show == 1:
        joint_positions = [35 + math.degrees(3.14159), -35, 125, 90, -90, 0]
    if show == 2:
        joint_positions = [j1 + math.degrees(3.14159), j2, j3, j4, j5, j6]
    joint_positions = [math.radians(a) for a in joint_positions]
    types = robot.get_configurable_joint_types(group)
    configuration = Configuration(joint_positions, types)
    print configuration
# ---------- end forward_kinematics ----------

filter_5 = StreamFilter(Gate=list_9, Stream0=forward_kinematics, Stream1=py_3)
plan_cartesian_motion = PythonScript(
    robot=robot.robot,
    group=main_planning_group,
    start_configuration=filter_5,
    planes=pln,
    iteration=iteration,
    reverse_list=reverse,
    max_step=10,
    compute=compute)  # -> out, robot, group, trajectory; inputs planes: list, iteration: Int32, reverse_list: Boolean
# ---------- plan_cartesian_motion: Python ----------
import logging
import scriptcontext as sc
from compas.geometry import Frame
from compas.geometry import Translation
import math
from compas_fab.robots import Configuration

guid = str(ghenv.Component.InstanceGuid)
response_key = "response_" + guid
translation_vector_key = "translation_vector" + guid
if response_key not in sc.sticky:
    sc.sticky[response_key] = None

if robot:
    if robot.client:
        if robot.client.is_connected:
            if start_configuration and compute:
                joint_positions = [math.radians(a) for a in [0, 0, 0, 0, 0, 0]]
                types = robot.get_configurable_joint_types(group)
                configuration = Configuration(joint_positions, types)
                frames_temp = robot.transformed_frames(configuration, group)
                f1 = frames_temp[8]
                f2 = frames_temp[9]
                translation_vector = [f1[0][1] - f2[0][1], 0, f1[0][2] - f2[0][2]]
                print translation_vector
                sc.sticky["translation_vector_key"] = translation_vector
                
                frames = []
                
                for i in range(iteration):
                    if reverse_list and i > 0:
                        planes.reverse()
                    for j, plane in enumerate(planes):
                        frame = Frame(plane.Origin, plane.ZAxis, -plane.XAxis)
#                        frame = Frame(plane.Origin, plane.ZAxis, plane.XAxis)
#                        x = Translation.from_vector(frame.xaxis.unitized() * -translation_vector[0])
#                        z = Translation.from_vector(frame.zaxis.unitized() * translation_vector[2])
#                        t_frame = frame.transformed(x)
#                        t_frame.transform(z)
#                        frames.append(t_frame)
                        frames.append(frame)
                        if j<2:
                            print frames
                
                options = {'max_step':float(max_step)}
                response = robot.plan_cartesian_motion(frames, start_configuration=start_configuration, group=group, options=options)
                sc.sticky[response_key] = response
        else:
            print("Robot is not connected")
            sc.sticky[response_key] = None

trajectory = sc.sticky[response_key]
# ---------- end plan_cartesian_motion ----------
vis = PythonScript(trajectory=plan_cartesian_motion.trajectory)  # -> P, V, A, time
# ---------- vis: Python ----------
from compas_ghpython import list_to_ghtree

if trajectory:

    positions = []
    velocities = []
    accelerations = []
    time_from_start = []

    for p in trajectory.points:
        positions.append(p.positions)
        velocities.append(p.velocities)
        accelerations.append(p.accelerations)
        time_from_start.append(p.time_from_start.seconds)

    P = list_to_ghtree(list(zip(*positions)))
    V = list_to_ghtree(list(zip(*velocities)))
    A = list_to_ghtree(list(zip(*accelerations)))
    time = time_from_start[-1]
# ---------- end vis ----------
multiplication = Multiplication(A=vis.time, B=4.25)
time_sec = Panel(multiplication)
panel_27 = Panel(plan_cartesian_motion.out)
py_4 = PythonScript(robot=plan_cartesian_motion.robot, group=plan_cartesian_motion.group, trajectory=plan_cartesian_motion.trajectory)  # -> start_configuration, configurations, full_configurations, frames, planes, fraction
# ---------- py_4: Python ----------
from compas_ghpython import draw_frame

joint_positions = []

if trajectory:
    configurations = trajectory.points
    start_configuration = trajectory.start_configuration
    fraction = trajectory.fraction
    time = trajectory.time_from_start
    full_configurations = [robot.merge_group_with_full_configuration(c, trajectory.start_configuration, group) for c in configurations]
    frames = [robot.forward_kinematics(c, group, options=dict(solver='model')) for c in full_configurations]
    planes = [draw_frame(frame) for frame in frames]
    P = [plane.Origin for plane in planes]
# ---------- end py_4 ----------
prismatic = QuickGraph(vis.P, SortOrder=0)
division = Division(A=time_sec, B=60)
time_min = Panel(division)
fraction = Panel(py_4.fraction)
scale = Scale(Geometry=py_4.planes, Center=Point(0, 0, 0), Factor=0.001)  # -> Geometry, Transform
graph = QuickGraph(vis.V, SortOrder=0)
graph_2 = QuickGraph(vis.A, SortOrder=0)
pline_4 = PolyLine(Vertices=scale.Geometry, Closed=False)
preview = CustomPreview(Geometry=scale.Geometry, Material=ColourSwatch(SwatchColor=RGB(59, 137, 161)))
counter = CountThroughList(L=py_4.full_configurations, start=start, step=step, reset=reset_2)  # -> item; inputs L: list, start: Boolean
# ---------- counter: Python ----------
from scriptcontext import sticky as st
from compas_ghpython.utilities import update_component


interval = 1

# store data in component
guid = str(ghenv.Component.InstanceGuid)
counter_key = "counter_" + guid
running_key = "running_" + guid

if counter_key not in st:
    st[counter_key] = 0

if running_key not in st:
    st[running_key] = False

if start:
    st[running_key] = True

if step:
    if st[counter_key] < len(L) - 1:
        st[counter_key] += 1
    
if len(L):
    item = L[st[counter_key]]

if st[running_key]:
    if st[counter_key] < len(L) - 1:
        st[counter_key] += 1
        update_component(ghenv, interval)
    else:
        st[counter_key] = 0
        st[running_key] = False
# ---------- end counter ----------
filter_6 = StreamFilter(Gate=state, Stream0=forward_kinematics, Stream1=counter)
visualize = PythonScript(
    mode=list_8,
    robot=robot.robot,
    robot_name=robot_name,
    configuration=filter_6,
    group=main_planning_group,
    scale_factor=units,
    show_visual=show_visual,
    show_axes=show_axes,
    show_end_effector_frame=show_end_effector_frame)  # -> visual, axes, axes_color, ee_frame_vis, ee_color, ee_frame, ee_plane
# ---------- visualize: Python ----------
from System.Drawing import Color
from compas_ghpython.utilities import draw_pipes
from compas_ghpython import draw_frame
from compas.geometry import Point
from compas.geometry import Vector
from compas.geometry import Translation

frames = []

size = .200 * scale_factor 
size_w = 2 * scale_factor 
radius = .008 * scale_factor
radius_w = .018 * scale_factor 

red = Color.FromArgb(255, 0, 0)
green = Color.FromArgb(0, 255, 0)
blue = Color.FromArgb(0, 0, 255)

frame_colors = [red, green, blue]


def pipes_from_frame(frame, size, radius): 
    pipes = []
    for axis in [frame.xaxis, frame.yaxis, frame.zaxis]:
        pipe = {}
        pipe['points'] = [list(frame.point), list(Point(*frame.point) + Vector(*axis) * size)]
        pipe['radius'] = radius
        pipes.append(pipe)
    return pipes


if robot and configuration and mode == 0:
    robot.update(configuration, visual=show_visual, collision=False)
    if show_visual:
        visual = robot.artist.draw_visual()
    if show_axes:
        pipes = []
        axes_color = []
        frames = robot.transformed_frames(configuration, group)
        for frame in frames:
            pipes += pipes_from_frame(frame, size, radius)
            axes_color += frame_colors
        axes = draw_pipes(pipes, cap=1)
    
    
    if show_end_effector_frame:
        frames = robot.transformed_frames(configuration, group)
        ee_frame = frames[8]
        ee_plane = draw_frame(ee_frame)
        print("End-effector", ee_frame)

        #Draw
        ee_pipes = pipes_from_frame(ee_frame, size, radius)
        ee_frame_vis = draw_pipes(ee_pipes, cap=1)
        ee_color = frame_colors
# ---------- end visualize ----------
preview_2 = CustomPreview(Geometry=visualize.axes, Shader=visualize.axes_color)
preview_3 = CustomPreview(Geometry=visualize.ee_frame_vis, Shader=visualize.ee_color)
preview_4 = CustomPreview(Geometry=visualize.visual, Shader=ColourSwatch(SwatchColor=RGB(105, 105, 105)))

# ==== cluster Cluster
print_boundary = ClusterInput()
G = ClusterInput()
G_2 = ClusterInput()
G_3 = ClusterInput()
ori = ClusterInput()
swatch = ColourSwatch(SwatchColor=RGB(255, 170, 255))
swatch_2 = ClusterOutput(swatch)
swatch_3 = ColourSwatch(SwatchColor=RGB(255, 170, 119))
swatch_4 = ClusterOutput(swatch_3)
boundary_visualization = GhPythonScript(ori=ori)  # -> T_rhino2UR; inputs ori: Point3d
# ---------- boundary_visualization: Python ----------
__author__ = "Fen"
import Rhino.Geometry as rg

T_rhino2UR = rg.Point3d(ori.X,ori.Y+1500,0) - ori
# ---------- end boundary_visualization ----------
repeat = RepeatData(Data=swatch_3, Length=3)
D = ClusterOutput(repeat)
repeat_2 = RepeatData(Data=swatch, Length=3)
D_2 = ClusterOutput(repeat_2)
move = Move(Geometry=G, Motion="{0,-50,0}")  # -> Geometry, Transform
move_2 = Move(Geometry=G_3, Motion="{0,-50,0}")  # -> Geometry, Transform
move_3 = Move(Geometry=G_2, Motion="{-50,-50,0}")  # -> Geometry, Transform
txt = Text(["UR Origin", "UR Y", "UR X", "Rh Origin", "Rh Y", "Rh X"])
txt_2 = ClusterOutput(txt)
pt = Point([move.Geometry, move_3.Geometry, move_2.Geometry])
move_4 = Move(Geometry=pt, Motion=boundary_visualization)  # -> Geometry, Transform
panel = ClusterOutput("3ds Light")
merge = Merge(Data1=pt, Data2=move_4.Geometry)
R = ClusterOutput(merge)
boundary_visualization_2 = GhPythonScript(T_rhino2UR=boundary_visualization, print_boundary=print_boundary)  # -> rhino_boundary, rhino_oriPt; inputs print_boundary: Curve
# ---------- boundary_visualization_2: Python ----------
__author__ = "Fen"
import Rhino.Geometry as rg
rhino_boundary = print_boundary.Duplicate()
rhino_boundary.Translate(T_rhino2UR)
rhino_boundary_bb = rhino_boundary.GetBoundingBox( rg.Plane.WorldXY)
rhino_oriPt = rhino_boundary_bb.Min
# ---------- end boundary_visualization_2 ----------
rhino_boundary = ClusterOutput(boundary_visualization_2.rhino_boundary)
rhino_oript = ClusterOutput(boundary_visualization_2.rhino_oriPt)
